# Grasshopper definition PackageOptimization.gh (Grasshopper 1.0.7)
# plug-ins: OpenNest, Human

offset = Slider(357, range=0..500)

# ---- group: Internalised Package Data / Right-click > Set one file path
path = FilePath("C:\Users\hnrus\Downloads\amazon_boxes_only_dimensions.csv")  # disabled

# ---- group: Internalised Package Data
# Import .csv
panel = Panel(path)  # disabled
file = ReadFile(File=path, PerLineParse=True)  # disabled

# ---- group: Optional Manual Crate Input
crate_y = Panel("""50
50
50""")
crate_x = Panel("""185
185
50""")
crate_z = Panel("""25
56
117""")

# ----
split = TextSplit(
    Text=["13,13,90", "23,15,9", "23,15,13", "23,17,6", "25,16,18", "25,18,8", "25,18,8", "25,18,13", "26,18,6", "16,30,41"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],
    Separators=",")

# ---- group: Optional Manual Crate Input
weave = Weave(Pattern=[0, 1, 2], Stream0=crate_x, Stream1=crate_y, Stream2=crate_z, NullGaps=False)

# ---- group: Creating the Variable Cabinet Layout
no_of_medium_drawers = Slider(3, range=0..10)
width_of_large_crate = Slider(40, range=0..200)
no_of_small_drawers = Slider(4, range=0..10)
wall_thickness = Slider(5, range=0..10)
container_size = Slider(250, range=0..1000)
division = Division(A=no_of_small_drawers, B=2)
multiplication = Multiplication(A=wall_thickness, B=3)
addition = Addition(A=no_of_medium_drawers, B=division)
rectangle = Rectangle(Plane=PlaneXY(0, 0, 0), XSize=container_size, YSize=container_size, Radius=0)  # -> Rectangle, Length
subtraction = Subtraction(A=container_size, B=multiplication)
addition_2 = Addition(A=addition, B=1)
merge = Merge(Data1=no_of_small_drawers, Data2=no_of_medium_drawers, Data3=2)
subtraction_2 = Subtraction(A=container_size, B=width_of_large_crate, C=wall_thickness)
division_2 = Division(A=subtraction, B=2)
multiplication_2 = Multiplication(A=wall_thickness, B=addition_2)
rectangle_2 = Rectangle(Plane=PlaneXY(0, 0, 0), XSize=width_of_large_crate, YSize=division_2, Radius=0)  # -> Rectangle, Length
multiplication_3 = Multiplication(A=wall_thickness, B=3)
subtraction_3 = Subtraction(A=container_size, B=multiplication_2)
# Determine grid
addition_3 = Addition(A=division_2, B=wall_thickness)
division_3 = Division(A=subtraction_3, B=addition)
subtraction_4 = Subtraction(A=container_size, B=width_of_large_crate, C=multiplication_3)
X = UnitX(Factor=subtraction_2)
series = Series(Start=wall_thickness, Step=addition_3, Count=2)
move = Move(Geometry=rectangle_2.Rectangle, Motion=X)  # -> Geometry, Transform
addition_4 = Addition(A=wall_thickness, B=division_3)
subtraction_5 = Subtraction(A=division_3, B=wall_thickness)
Y = UnitY(Factor=series)
division_4 = Division(A=subtraction_5, B=2)
move_2 = Move(Geometry=move.Geometry, Motion=Y)  # -> Geometry, Transform
addition_5 = Addition(A=wall_thickness, B=division_4)
series_2 = Series(Start=wall_thickness, Step=addition_4, Count=addition)
rectangle_3 = Rectangle(Plane=PlaneXY(0, 0, 0), XSize=subtraction_4, YSize=division_3, Radius=0)  # -> Rectangle, Length
rectangle_4 = Rectangle(Plane=PlaneXY(0, 0, 0), XSize=subtraction_4, YSize=division_4, Radius=0)  # -> Rectangle, Length
series_3 = Series(Start=wall_thickness, Step=addition_5, Count=no_of_small_drawers)
X_2 = UnitX(Factor=wall_thickness)
move_3 = Move(Geometry=rectangle_3.Rectangle, Motion=X_2)  # -> Geometry, Transform
move_4 = Move(Geometry=rectangle_4.Rectangle, Motion=X_2)  # -> Geometry, Transform
merge_2 = Merge(Data1=rectangle_3.Rectangle, Data2=rectangle_4.Rectangle, Data3=rectangle_2.Rectangle)
Y_2 = UnitY(Factor=series_2)
Y_3 = UnitY(Factor=series_3)
boxprop = BoxProperties(Box=merge_2)  # -> Center, Diagonal, Area, Volume, Degeneracy
move_5 = Move(Geometry=move_3.Geometry, Motion=Y_2)  # -> Geometry, Transform
subtraction_6 = Subtraction(A=division, B=1)
move_6 = Move(Geometry=move_4.Geometry, Motion=Y_3)  # -> Geometry, Transform
crate_depth = Slider(60, range=50..100)
pdecon = Deconstruct(Point=boxprop.Diagonal)  # -> XComponent, YComponent, ZComponent
cull_i = CullIndex(List=move_5.Geometry, Indices=subtraction_6, Wrap=True)
neg = Negative(Value=offset)
addition_6 = Addition(A=pdecon.ZComponent, B=crate_depth)

# ----
rec = Rectangle(merge_2)
panel_2 = Panel(rec)
merge_3 = Merge(Data1=cull_i, Data2=move_6.Geometry, Data3=move_2.Geometry, Data4=rectangle.Rectangle)
X_3 = UnitX(Factor=neg)
sort = SortList(Keys=pdecon.YComponent, ValuesA=pdecon.XComponent)  # -> Keys, ValuesA

# ---- group: Creating the Variable Cabinet Layout (continued)
move_7 = Move(Geometry=merge_3, Motion=X_3)  # -> Geometry, Transform
weave_2 = Weave(Pattern=[0, 1, 2], Stream0=sort.ValuesA, Stream1=addition_6, Stream2=sort.Keys, NullGaps=False)

# ---- group: Cabinet Curve Display
crv = Curve(move_7.Geometry)
previewlw = CustomPreviewLineweights(Geometry=crv, Shader=ColourSwatch(SwatchColor=RGB(255, 107, 107)), Absolute=False)

# ---- group: Crate Definition
lng = ListLength(List=weave_2)
partition = PartitionList(List=weave_2, Size=3)
division_5 = Division(A=lng, B=3)
crates = Data(partition)

# ---- group: Python Orientation Pipeline
modular = Slider(5, range=0..10)
pshift = ShiftPaths(Data=split, Offset=1)
python = GhPythonScript(boxes=pshift, modular=modular, crates=partition)  # -> out, no_fit_ints, simplify(box), simplify(box_mod); inputs boxes: tree, crates: tree
# ---------- python: Python ----------
__author__ = "jirri"
__version__ = "2022.10.03"

import math
import ghpythonlib.treehelpers as th


crates = th.tree_to_list(crates)
boxes = th.tree_to_list(boxes)

#Definition to replace math.prod because GHPython sucks
def prod(input):
    result = 1
    for x in input:
        result *= x
    return result

#Relative max error to crate size, to account for unit differences
max_error = float("inf")#int(prod(boxes[0])*1000)

#Initialize arrays (list of lists) to save data without appending 
crate_error_arr = [[] for i in range(len(boxes))]
orient_arr = [[] for i in range(len(boxes))]

#First, loop through all crates
for crate in crates:
    #Second, loop through all boxes
    for c, box in enumerate(boxes):
        indices = [1,2,0]
        #Third, loop through all orientations
        for orient in box:
            #Sort the index list for all orientations and order box appropriately
            indices.insert(0,indices.pop())
            box = [box[i] for i in indices]
            #Add all orientations to an array for later access
            orient_arr[c].append(box)
            #Check all three dimension values to see if it fits
            score = 0
            for i in range(0,3):
                if box[i] <= crate[i]:
                    score += 1
            #If this orientation fits: calculate the error , taking the modular system into account
            #Error is defined as: ((area in modular) * height of crate) - volume of box
            if score == 3:
                box_vol = prod(box)
                tot_vol = (math.ceil(box[0]/modular)*modular)*(math.ceil(box[1]/modular)*modular)*crate[2]
                error = int(tot_vol - box_vol)
                crate_error_arr[c].append(error)
            #If the orientation doesn't fit use the max_error
            else:
                crate_error_arr[c].append(max_error)

#With the errors established, the correct orientations can be sorted to their respective crates
crates_int = [0 for i in range(len(boxes))]
orient_int = [0 for i in range(len(boxes))]

#Loop over all errors to find the index of the best result, if no orientation fits -1 is used as index
for c, crate_error_list in enumerate(crate_error_arr):
    best_index = crate_error_list.index(min(crate_error_list))
    if crate_error_list[best_index] != max_error:
        #Recalculate the index to the smaller crate index
        best_crate = int(math.floor(best_index / 3))
        best_orient = best_index
    else:
        best_crate = -1
        best_orient = -1
    crates_int[c] = best_crate
    orient_int[c] = best_orient

#Using the index of the best crate and orientation, add these box dimensions to the output array
orient_out = [[] for i in range(len(crates))]
for c,orient in enumerate(orient_arr):
    crate_int = crates_int[c]
    if crate_int != -1:
        orient_out[crate_int].append(orient[orient_int[c]])

#Also output a version of the box list with dimensions rounded to the modular system
box_mod_out = [[] for i in range(len(crates))]
for c, i in enumerate(orient_out):
    for box in i:
        hold = [0,0,0]
        for d, j in enumerate(box):
            hold[d] = math.ceil(j/modular)*modular
        box_mod_out[c].append(hold)

no_fit_ints = [c for c,i in enumerate(crates_int) if i == -1]

print('Currently ' + str(crates_int.count(-1)) +'/'+str(len(boxes))+' boxes do not fit in any crate')

# print(crates_int)
# print(orient_out)
# print(box_mod_out)

box = th.list_to_tree(orient_out)
box_mod = th.list_to_tree(box_mod_out)
# ---------- end python ----------
panel_3 = Panel(python.out)

# ---- group: Standard Split
trim = TrimTree(Tree=python.box_mod, Depth=1)
lng_2 = ListLength(List=trim)
division_6 = Division(A=lng_2, B=3)  # -> flatten(Result)
panel_4 = Panel(division_6)

# ---- group: Data Preview
box = Panel(python.box)
box_mod = Panel(python.box_mod)

# ---- group: Find none fitting Boxes
lng_3 = ListLength(List=python.no_fit_ints)
repeat = RepeatData(Data=0, Length=lng_3)
entwine = Entwine(Branch00=repeat, Branch01=python.no_fit_ints, FlattenInputs=True)
flip = FlipMatrix(Data=entwine)
path_2 = ConstructPath(Indices=flip)
branch = TreeBranch(Tree=pshift, Path=path_2, MaintainPaths=True)
panel_5 = Panel(branch)

# ---- group: Create Sheets
crates_2 = Data(crates)
item = ListItem(List=crates_2, Index=0, Wrap=True)  # -> Item, Item1
rectangle_5 = Rectangle(Plane=PlaneXY(0, 0, 0), XSize=item.Item, YSize=item.Item1, Radius=0)  # -> simplify(Rectangle), Length

# ---- group: Move Crate Groups
lng_4 = ListLength(List=flatten(rectangle_5.Rectangle))
series_4 = Series(Start=0, Step=Slider(100, range=0..100), Count=lng_4)
neg_2 = Negative(Value=series_4)
Y_4 = UnitY(Factor=neg_2)  # -> graft(UnitVector)

# ---- group: Creating the Variable Cabinet Layout (continued)
txt = Text(python.out)
panel_6 = Panel(txt)

# ---- group: Weighted Random selection of Box types
no_crates = Integer(division_5)
division_7 = Division(A=1, B=no_crates)
series_5 = Series(Start=division_7, Step=division_7, Count=no_crates)
graph = GraphMapper(
    series_5,
    x0=0,
    x1=1,
    y0=0,
    y1=1,
    container_name="Bezier",
    cpx=[0, 0.464925766, 0.5570543408, 1],
    cpy=[0, 0.7473595738, 1, 1])
multiplication_4 = Multiplication(A=graph, B=Slider(300, range=0..1000))
int = Integer(multiplication_4)
item_2 = ListItem(List=int, Index=0, Wrap=True)
reldif = RelativeDifferences(Values=int)
item_3 = ListItem(List=reldif, Index=0, Wrap=True)  # -> Item, Item1, Item2
merge_4 = Merge(Data1=item_2, Data2=item_3.Item1, Data3=item_3.Item2)
data = Data(merge_4)
panel_7 = Panel(data)

# ---- group: Create Display Grid
y_offset_start = Slider(100, range=0..1000)
grid_size = Slider(150, range=0..150)
xy = XYPlane(Origin=Point(0, 0, 0))
Y_5 = UnitY(Factor=y_offset_start)
rectangle_6 = Rectangle(Plane=PlaneXY(0, 0, 0), XSize=grid_size, YSize=grid_size, Radius=0)  # -> Rectangle, Length
move_8 = Move(Geometry=xy, Motion=Y_5)  # -> Geometry, Transform

# ---- group: Box to Parameters
box_mod_2 = Data(python.box_mod)
item_4 = ListItem(List=box_mod_2, Index=0, Wrap=True)  # -> Item, Item1, Item2
rectangle_7 = Rectangle(Plane=PlaneXY(0, 0, 0), XSize=item_4.Item, YSize=item_4.Item1, Radius=0)  # -> Rectangle, Length
trim_2 = TrimTree(Tree=rectangle_7.Rectangle, Depth=1)
rectangles_prepick = Rectangle(trim_2)
rectangles = Rectangle(trim_2)

# ---- group: Weighted Random selection of Box types (continued)
rectangles_prepick_2 = Rectangle(rectangles_prepick)
lng_5 = ListLength(List=rectangles_prepick_2)
dom = ConstructDomain(DomainStart=0, DomainEnd=lng_5)  # -> flatten(Domain)
random = Random(Range=dom, Number=merge_4, Seed=2, Integers=True)

# ----
trim_3 = TrimTree(Tree=item_4.Item2, Depth=1)

# ---- group: Box to Parameters (continued)
height = Number(trim_3)

# ---- group: Select Random Packages
item_5 = ListItem(List=trim_2, Index=random, Wrap=True)
rectangles_2 = Rectangle(item_5)

item_6 = ListItem(List=height, Index=random, Wrap=True)
height_2 = Number(item_6)

# ---- group: Choose to use random selection
use_random_sel = BooleanToggle(True)
filter = StreamFilter(Gate=use_random_sel, Stream0=rectangles, Stream1=rectangles_2)
filter_2 = StreamFilter(Gate=use_random_sel, Stream0=height, Stream1=height_2)

# ---- group: Create Display Grid (continued)
rectangles_3 = Rectangle(graft(filter))
lng_6 = ListLength(List=flatten(rectangles_3))
sqrt = SquareRoot(Value=lng_6)
round = Round(Number=sqrt)  # -> Nearest, Floor, Ceiling
arrrec = RectangularArray(Geometry=move_8.Geometry, Cell=rectangle_6.Rectangle, XCount=round.Ceiling, YCount=round.Ceiling)  # -> Geometry, Transform
lng_7 = ListLength(List=arrrec.Geometry)
subtraction_7 = Subtraction(A=lng_7, B=lng_6)
series_6 = Series(Start=0, Step=1, Count=subtraction_7)
cull_i_2 = CullIndex(List=reverse(arrrec.Geometry), Indices=series_6, Wrap=True)  # -> reverse(graft(List))
match = MatchTree(Tree=cull_i_2, Guide=rectangles_3)
trim_4 = TrimTree(Tree=match, Depth=1)
display_plane = Plane(trim_4)

# ---- group: 3D for display
rectangles_4 = Data(filter)
height_3 = Number(filter_2)
display_plane_2 = Plane(display_plane)
boxrec = BoxRectangle(Rectangle=rectangles_4, Height=height_3)
orient = Orient(Geometry=boxrec, Source=PlaneXY(0, 0, 0), Target=display_plane_2)  # -> Geometry, Transform
box_base = Geometry(boxrec)
geo = Geometry(orient.Geometry)

# ---- group: Display Rectangle
display_plane_3 = Plane(display_plane)
rectangles_5 = Data(filter)
orient_2 = Orient(Geometry=rectangles_5, Source=PlaneXY(0, 0, 0), Target=display_plane_3)  # -> Geometry, Transform
crv_2 = Curve(orient_2.Geometry)

# ---- group: Activate packing calculation
# Save before use
# and you'd better not be moving
# any sliders when enabled
gate = StreamGate(Stream=filter, Gate=Toggle(True))  # -> Target0, Target1
dam = DataDam(DataA=gate.Target1, BufferDelay=10000000, BufferMode=0)

# ---- group: No of Packages per Crate type
viewer = ParamViewer(filter)

# ---- group: Create Geo and Sheets
rectangles_6 = Rectangle(gate.Target1)
rectangles_7 = Curve(rectangles_6)
tolerance_scale = Slider(0.99, range=0..1)
area = Area(Geometry=rectangles_7, UseTasks=False)  # -> Area, Centroid
scale = Scale(Geometry=rectangles_7, Center=area.Centroid, Factor=tolerance_scale)  # -> Geometry, Transform

# ---- group: OpenNest Main
opennest = OpenNest(
    Sheets=rectangle_5.Rectangle,
    Geo=scale.Geometry,
    Spacing=0,
    Placement=1,
    Tolerance=1,
    Rotations=4,
    Iterations=2,
    Seed=1,
    Reset=Button(),
    Run=Toggle(False))  # -> Sheets, Geo, ID, Transform, IDS

# ---- group: Non fitting Error check
expression = Expression(x=opennest.IDS, Expression="If(x=-1,1,0)")
ma = MassAddition(Input=expression)  # -> Result, PartialResults
panel_8 = Panel(ma.Result)

# ---- group: Upscaling from 99%
dematrix = DeconstructMatrix(Matrix=simplify(opennest.Transform))  # -> Rows, Columns, Values
modular_2 = Number(modular)
panel_9 = Panel("""0
0
0
1
0
0
0
1
0
0
0
0
0
0
0
0""")
sift = SiftPattern(List=dematrix.Values, SiftPattern=panel_9)  # -> Output0, Output1
division_8 = Division(A=modular_2, B=2)
division_9 = Division(A=sift.Output1, B=division_8)
round_2 = Round(Number=division_9)  # -> Nearest, Floor, Ceiling
multiplication_5 = Multiplication(A=round_2.Ceiling, B=division_8)
combine = CombineData(Input0=sift.Output0, Input1=multiplication_5)  # -> Result, Index
matrix = ConstructMatrix(Rows=dematrix.Rows, Columns=dematrix.Columns, Values=simplify(combine.Result))
lng_8 = ListLength(List=opennest.Transform)  # -> flatten(Length)
item_7 = ListItem(List=matrix, Index=0, Wrap=True)
partition_2 = PartitionList(List=flatten(item_7), Size=lng_8)

# ---- group: Sheets
move_9 = Move(Geometry=opennest.Sheets, Motion=Y_4)  # -> Geometry, Transform

# ----
lng_9 = ListLength(List=move_9.Geometry)  # -> flatten(Length)

# ---- group: No of Crates per type
viewer_2 = ParamViewer(move_9.Geometry)

# ----
ma_2 = MassAddition(Input=lng_9)  # -> Result, PartialResults
merge_5 = Merge(Data1=lng_9, Data2=ma_2.Result)

# ---- group: Creating the Variable Cabinet Layout (continued)
data_2 = Data(merge_5)
no_of_crates_per_type = Panel(data_2)
data_3 = Data(lng_9)
division_10 = Division(A=data_3, B=merge)
round_3 = Round(Number=division_10)  # -> Nearest, Floor, Ceiling
panel_10 = Panel(round_3.Ceiling)

# ----
matrix_2 = TransformMatrix(opennest.Transform, Digits=3)

# ---- group: Fitted Geo
box_base_2 = Geometry(box_base)
transform = Transform(Geometry=box_base_2, Transform=partition_2)
move_10 = Move(Geometry=transform, Motion=Y_4)  # -> Geometry, Transform

transform_2 = Transform(Geometry=rectangles_7, Transform=partition_2)
move_11 = Move(Geometry=transform_2, Motion=Y_4)  # -> Geometry, Transform
