# Grasshopper definition ProgramPlacement.gh (Grasshopper 1.0.7)
# plug-ins: Hops, LunchBox

panel = Panel("plot")
panel_2 = Panel("Site Option 0")
panel_3 = Panel("road")
panel_4 = Panel("sidewalk")
panel_5 = Panel("nearby buildings")
panel_6 = Panel("landmarks")
panel_7 = Panel("views")
brep = Brep([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])
pt = Point([Point(5.913946775, 16.01979122, 0), Point(17.88405521, 15.17234991, 0), Point(17.67219488, 5.108984413, 0)])
pt_2 = Point(Point(-5.314650517, -3.577288964, 0))
pt_3 = Point(Point(-28.83114673, 5.638635228, 0))
srf = Surface(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)
line = Line(Line((-2.751304186, -2.172082252, 0), (12.74288255, -2.172082252, 0)))
line_2 = Line([Line((-2.751304186, -0.9774370135, 0), (12.74288255, -0.9774370135, 0)), Line((11.58443868, -0.9774370135, 0), (11.58443868, 11.83784827, 0))])

panel_10 = Panel("Site Option 1")
brep_2 = Brep([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])
pt_4 = Point([Point(5.913946775, 16.01979122, 0), Point(-4.866496589, 3.531202917, 0), Point(6.494440484, -4.673675119, 0)])
pt_5 = Point(Point(-28.83114673, 5.638635228, 0))
pt_6 = Point(Point(-28.83114673, 5.638635228, 0))
srf_2 = Surface(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)
line_3 = Line(Line((-2.530973154, 12.83819242, 0), (13.57880973, 12.83819242, 0)))
line_4 = Line(Line((-2.587269307, 11.91638794, 0), (13.40337934, 11.91638794, 0)))

panel_17 = Panel("select program order")

# ----
# !!!run hops server to use custom nodes!!!
# Open the code in visual studio
# Navigate to unpack > hops > app.py and double click the file to open
# Press the play button in the upper right corner
# 
# Close this file and close Rhino
# Open Rhino and Grasshopper file
# number of modules to place after package and utilities
panel_18 = Panel("select site option")
panel_19 = Panel("flask server address")
panel_20 = Panel("grid size")
number_slider = Slider(0, range=0..1)
number_slider_2 = Slider(3, range=0..3)

entwine = Entwine(Branch00=line, Branch01=line_3, FlattenInputs=True)  # -> simplify(Result)
entwine_2 = Entwine(Branch00=srf, Branch01=srf_2, FlattenInputs=True)  # -> simplify(Result)
entwine_3 = Entwine(Branch00=line_2, Branch01=line_4, FlattenInputs=True)  # -> simplify(Result)
entwine_4 = Entwine(Branch00=brep, Branch01=brep_2, FlattenInputs=True)  # -> simplify(Result)
entwine_5 = Entwine(Branch00=pt_2, Branch01=pt_5, FlattenInputs=True)  # -> simplify(Result)
entwine_6 = Entwine(Branch00=pt, Branch01=pt_4, FlattenInputs=True)  # -> simplify(Result)
entwine_7 = Entwine(Branch00=pt_3, Branch01=pt_6, FlattenInputs=True)  # -> simplify(Result)
branch = TreeBranch(Tree=entwine, Path=number_slider, MaintainPaths=True)
branch_2 = TreeBranch(Tree=entwine_2, Path=number_slider, MaintainPaths=True)
branch_3 = TreeBranch(Tree=entwine_3, Path=number_slider, MaintainPaths=True)
branch_4 = TreeBranch(Tree=entwine_4, Path=number_slider, MaintainPaths=True)
branch_5 = TreeBranch(Tree=entwine_5, Path=number_slider, MaintainPaths=True)
branch_6 = TreeBranch(Tree=entwine_6, Path=number_slider, MaintainPaths=True)
branch_7 = TreeBranch(Tree=entwine_7, Path=number_slider, MaintainPaths=True)
path_mapper = PathMapper(branch, source="{A}", target="{0}")
path_mapper_2 = PathMapper(branch_3, source="{A}", target="{0}")
path_mapper_3 = PathMapper(branch_7, source="{A}", target="{0}")
path_mapper_4 = PathMapper(branch_5, source="{A}", target="{0}")
path_mapper_5 = PathMapper(branch_6, source="{A}", target="{0}")
path_mapper_6 = PathMapper(branch_2, source="{A}", target="{0}")
path_mapper_7 = PathMapper(branch_4, source="{A}", target="{0}")

panel_21 = Panel("context")
preview = CustomPreview(
    Geometry=[branch_2, branch, branch_3, branch_6, branch_5, branch_7, branch_4],
    Material=ColourSwatch(SwatchColor=RGBA(178, 178, 178, 142)))

# ----
# distance to road, distance to sidewalk, sun hours, nearby buildings, distance to landmark, distance to view
panel_22 = Panel("cost function")

# ----
# navigate to excel file with module information
path = FilePath()

# ----
# extract module data from excel
toggle = BooleanToggle(True)
toggle_2 = BooleanToggle(True)
excelread = ExcelReader(ReadExcelData=toggle, WorkbookPath=path, WorksheetName="ModuleList")  # -> Exceptions, ExcelData
cull_i = CullIndex(List=excelread.ExcelData, Indices="0", Wrap=True)
num = Number(cull_i)
clean = CleanTree(RemoveNulls=toggle_2, RemoveInvalid=toggle_2, RemoveEmpty=toggle_2, Tree=num)
lng = ListLength(List=clean)
item = ListItem(List=flatten(lng), Index=0, Wrap=True)
subtraction = Subtraction(A=item, B=1)
dom = ConstructDomain(DomainStart=0, DomainEnd=subtraction)
subset = SubList(List=cull_i, Domain=dom, Wrap=True)  # -> List, Index

# ----
# excel data internalized here
data = Data(Tree({0;0;0}: ["packages", "services", "bikes", "bottle_return", "cafe", "droid_port", "fab_lab", "flitz", "green_wall", "groceries", "snack_bar", "medicine_pickup"], {1;0;0}: ["3", "2", "3", "1", "2", "1", "3", "3", "3", "3", "2", "1"], {2;0;0}: ["6", "2", "2", "2", "2", "2", "4", "3", "1", "3", "2", "2"], {3;0;0}: ["3", "3", "3", "3", "3", "3", "3", "3", "3", "3", "3", "3"], {4;0;0}: ["1,0,0,0,0,0", "0,-1,0,0,0,0", "1,0,0,0,0,0", "1,1,0,0,0,0", "0,1,0,0,1,1", "1,0,0,0,0,0", "1,0,0,-1,0,0", "1,0,0,0,0,0", "0,0,1,-1,0,0", "1,0,0,0,0,0", "0,1,0,0,1,1", "1,1,0,0,0,0"], {5;0;0}: ["P0: packages", "P1: services", "P2: bikes", "P9: bottle_return", "P5: cafe", "P3: droid_port", "P6: fab_lab", "P8: flitz", "P11: green_wall", "P7: groceries", "P10: snack_bar", "P4: medicine_pickup"], {6;0;0}: ["0", "1", "2", "9", "5", "3", "6", "8", "11", "7", "10", "4"], {7;0;0}: ["0,3,0,4", "None", "1,0,2,0", "0,0,1,0", "1,0", "0,0,1,0", "0,2,0,3", "1,0,2,0", "1,0,2,0", "1,0,2,0", "1,0", "0,0,1,0"]))

data_2 = Data(["0", "1", "2", "9", "5", "3", "6", "8", "11", "7", "10", "4"])
data_3 = Data(["0", "1", "9", "8", "10", "11", "6", "3", "7", "2", "4", "5"])
data_4 = Data(["0", "1", "2", "3", "4", "5", "6", "7", "8", "9", "10", "11"])
panel_23 = Panel("change program order")
entwine_8 = Entwine(Branch00=data_2, Branch01=data_4, Branch02=data_3, FlattenInputs=True)  # -> simplify(Result)
branch_8 = TreeBranch(Tree=entwine_8, Path=Slider(0, range=0..2), MaintainPaths=True)

panel_24 = Panel("""{0} use
{1} length
{2} width
{3} height
{4} module mask
{5} layer
{6} importance
{7} door""")
bang = ExplodeTree(Data=data)  # -> Branch0, Branch1, Branch2, Branch3, Branch4, Branch5, Branch6, Branch7

txt = Text(branch_8)

panel_25 = Panel("door points")
sort = SortList(Keys=txt, ValuesA=bang.Branch7)  # -> Keys, ValuesA

panel_26 = Panel("create module geometry")
xy = XYPlane(Origin=Point(0, 0, 0))
rectangle = Rectangle(Plane=xy, XSize=bang.Branch1, YSize=bang.Branch2, Radius=0)  # -> Rectangle, Length
panel_27 = Panel("sorted surfaces")
boundary = BoundarySurfaces(Edges=rectangle.Rectangle)
sort_2 = SortList(Keys=txt, ValuesA=boundary)  # -> Keys, ValuesA

panel_28 = Panel("sorted use")
sort_3 = SortList(Keys=txt, ValuesA=bang.Branch0)  # -> Keys, ValuesA

panel_29 = Panel("module mask")
sort_4 = SortList(Keys=txt, ValuesA=bang.Branch4)  # -> Keys, ValuesA

# ----
# A: package module
# B: all other modules (sorted by priority)
# DUE TO LIMITATIONS WITH HOPS:
# ALL TREE INPUTS MUST BE SIMPLIFIED TREE STRUCTURE {0}, {1}, {2} etc,
# SURFACES MUST BE IN FLATTENED LIST
# ALL TREE INPUTS MUST BE SIMPLIFIED TREE STRUCTURE {0}, {1}, {2} etc,
# ALL TREE INPUTS MUST BE SIMPLIFIED TREE STRUCTURE {0}, {1}, {2} etc,
dom_2 = ConstructDomain(DomainStart=0, DomainEnd=number_slider_2)
panel_30 = Panel("format data")
split = SplitList(List=sort.ValuesA, Index="1")  # -> simplify(ListA), simplify(ListB)
split_2 = SplitList(List=sort_3.ValuesA, Index="1")  # -> simplify(ListA), simplify(ListB)
split_3 = SplitList(List=sort_4.ValuesA, Index="1")  # -> simplify(ListA), simplify(ListB)
split_4 = SplitList(List=sort_2.ValuesA, Index="1")  # -> simplify(ListA), simplify(flatten(ListB))
subset_2 = SubList(List=split.ListB, Domain=dom_2, Wrap=True)  # -> simplify(graft(List)), Index
subset_3 = SubList(List=split_2.ListB, Domain=dom_2, Wrap=True)  # -> simplify(graft(List)), Index
subset_4 = SubList(List=split_4.ListB, Domain=dom_2, Wrap=True)  # -> simplify(flatten(List)), Index
subset_5 = SubList(List=split_3.ListB, Domain=dom_2, Wrap=True)  # -> simplify(graft(List)), Index

# ----
# colours to match project color code
panel_31 = Panel("""229
197
26
133
161
255
91
72
76
151
142""")
panel_32 = Panel("""79
218
37
145
42
255
8
84
76
181
160""")
panel_33 = Panel("""255
130
18
73
250
228
202
63
230
53
128""")
entwine_9 = Entwine(Branch00=panel_33, Branch01=panel_31, Branch02=panel_32, FlattenInputs=True)
dom_3 = ConstructDomain(DomainStart=0, DomainEnd=number_slider_2)
subset_6 = SubList(List=entwine_9, Domain=dom_3, Wrap=True)  # -> simplify(List), Index
bang_2 = ExplodeTree(Data=subset_6.List)  # -> Branch0, Branch1, Branch2
rgb = ColourRGB(Alpha=255, Red=bang_2.Branch0, Green=bang_2.Branch1, Blue=bang_2.Branch2)

# ----
# fix bug with tree structure when certain inputs are set to 0
tstat = TreeStatistics(Tree=subset_3.List)  # -> Paths, Length, Count
tstat_2 = TreeStatistics(Tree=subset_4.List)  # -> Paths, Length, Count
tstat_3 = TreeStatistics(Tree=subset_2.List)  # -> Paths, Length, Count
tstat_4 = TreeStatistics(Tree=subset_5.List)  # -> Paths, Length, Count
item_2 = ListItem(List=tstat.Paths, Index=0, Wrap=True)
item_3 = ListItem(List=tstat_2.Paths, Index=0, Wrap=True)
item_4 = ListItem(List=tstat_3.Paths, Index=0, Wrap=True)
item_5 = ListItem(List=tstat_4.Paths, Index=0, Wrap=True)
dpath = DeconstructPath(Branch=item_2)
dpath_2 = DeconstructPath(Branch=item_3)
dpath_3 = DeconstructPath(Branch=item_4)
dpath_4 = DeconstructPath(Branch=item_5)
lng_2 = ListLength(List=flatten(dpath))
lng_3 = ListLength(List=flatten(dpath_2))
lng_4 = ListLength(List=flatten(dpath_3))
lng_5 = ListLength(List=flatten(dpath_4))
subtraction_2 = Subtraction(A=lng_2, B=1)
subtraction_3 = Subtraction(A=lng_3, B=1)
subtraction_4 = Subtraction(A=lng_4, B=1)
subtraction_5 = Subtraction(A=lng_5, B=1)
pshift = ShiftPaths(Data=subset_3.List, Offset=subtraction_2)
pshift_2 = ShiftPaths(Data=subset_4.List, Offset=subtraction_3)
pshift_3 = ShiftPaths(Data=subset_2.List, Offset=subtraction_4)
pshift_4 = ShiftPaths(Data=subset_5.List, Offset=subtraction_5)

# ----
# DUE TO LIMITATIONS WITH HOPS:
# ALL TREE INPUTS MUST BE SIMPLIFIED TREE STRUCTURE {0}, {1}, {2} etc, this node only accepts 2D trees
data_5 = Data(pshift)
data_6 = Data(pshift_2)
data_7 = Data(pshift_4)

epw_url = Panel("https://energyplus-weather.s3.amazonaws.com/europe_wmo_region_6/NLD/NLD_Amsterdam.062400_IWEC/NLD_Amsterdam.062400_IWEC.zip")
downloadepw = LBDownloadWeather(weather_URL=epw_url)  # -> epw_file, stat_file, ddy_file; plug-in component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
importepw = LBImportEPW(epw_file=downloadepw.epw_file)  # -> location, dry_bulb_temperature, dew_point_temperature, relative_humidity, wind_speed, wind_direction, direct_normal_rad, diffuse_horizontal_rad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; plug-in component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
month = Slider(1, range=1..12)
hour = Slider(20, range=0..100)
day = Slider(21, range=0..100)
hour_2 = Slider(8, range=0..100)
month_2 = Slider(12, range=1..12)
day_2 = Slider(21, range=0..100)
analysisperiod = LBAnalysisPeriod(start_month=month, start_day=day, start_hour=hour_2, end_month=month_2, end_day=day_2, end_hour=hour)  # -> period, hoys, dates; plug-in component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
debrep = DeconstructBrep(Brep=srf)  # -> Faces, Edges, Vertices
sunpath = LBSunPath(location=importepw.location, hoys=analysisperiod.hoys, scale=1)  # -> out, vectors, altitudes, azimuths, hoys, sun_pts, analemma, daily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; plug-in component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
item_6 = ListItem(List=debrep.Vertices, Index=0, Wrap=True)  # -> Item, Item1, Item2
dist = Distance(PointA=item_6.Item, PointB=item_6.Item1)
dist_2 = Distance(PointA=item_6.Item1, PointB=item_6.Item2)
run_the_calculation = BooleanToggle(True)
division = Division(A=dist, B="1")
division_2 = Division(A=dist_2, B="1")

# ----
# DUE TO LIMITATIONS WITH HOPS:
# Nearby Buildings, Landmarks, and Views must be entwined into one data tree with three simplified branches
get_point = GetPoint(path_mapper_5, AtLeast=1, AtMost=1, Realtime=True, TreeAccess=False)
get_point_2 = GetPoint(path_mapper_4, AtLeast=1, AtMost=1, Realtime=True, TreeAccess=False)
get_point_3 = GetPoint(path_mapper_3, AtLeast=1, AtMost=1, Realtime=True, TreeAccess=False)
panel_34 = Panel("results from ladybug")
get_geometry = GetGeometry(path_mapper_7, AtLeast=1, AtMost=1, DeleteInput=False, Filter=1074004029, TreeAccess=False)
entwine_10 = Entwine(Branch00=get_point, Branch01=get_point_2, Branch02=get_point_3, FlattenInputs=True)  # -> simplify(Result)
get_geometry_2 = GetGeometry(path_mapper_6, AtLeast=1, AtMost=1, DeleteInput=False, Filter=1074004029, TreeAccess=False)
get_line = GetLine(path_mapper, AtLeast=1, AtMost=1, Realtime=True, TreeAccess=False)
get_line_2 = GetLine(path_mapper_2, AtLeast=1, AtMost=1, Realtime=True, TreeAccess=False)
get_integer = GetInteger("1", AtLeast=1, AtMost=1, Maximum=2147483647, Minimum=-2147483648, TreeAccess=False)
concat = Concatenate(FragmentA="http://127.0.0.1:5000", FragmentB="/dividesite")

directsunhours = LBDirectSunHours(
    vectors=flatten(sunpath.vectors),
    geometry=flatten(get_geometry_2),
    context=flatten(get_geometry),
    grid_size="1",
    run=run_the_calculation)  # -> out, points, results, mesh, legend, title, int_mtx; plug-in component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
reorder_lb_results = GhPythonScript(data=directsunhours.results, site_length=division, site_width=division_2, step="1")  # -> out, formated_data; inputs data: list
# ---------- reorder_lb_results: Python ----------
"""Provides a scripting component.
    Inputs:
        data: The analysis information to reorder
        site length: The dimension of the site (along the Y axis)
    Output:
        formated_data: Ladybug data formated to match pointgrid"""

__author__ = "lisam"
__version__ = "2022.10.23"

import rhinoscriptsyntax as rs
import ghpythonlib.treehelpers as th

formated_data_list = []

for i in range(int(site_length)):
    row_list = []
    for j in range(i, int(site_width)*int(site_length)+i, int(site_length)):
        row_list.append(data[j])
        if j + int(site_length) == int(site_width)*int(site_length)+i:
            row_list.append(data[j])
    formated_data_list.append(row_list)
    if i == int(site_length)-int(step):
        formated_data_list.append(row_list)

formated_data = th.list_to_tree(formated_data_list)
# ---------- end reorder_lb_results ----------

int = Integer(simplify(reorder_lb_results.formated_data))

hops = Hops(
    _Path=concat,
    Geometry=get_geometry_2,
    RoadLines=get_line,
    SidewalkLines=get_line_2,
    Integer=get_integer,
    ContextPointS=entwine_10,
    SunAnalysis=int,
    CacheResultsInMemory=False,
    CacheSolveResults=False,
    RemoteDefinitionLocation="http://127.0.0.1:5000/dividesite",
    RemoteSolveVersion=(0, 1, 0),
    ShowInput_Enabled=False,
    ShowInput_Path=True,
    SynchronousSolve=True)  # -> Points, Cost, Lables
panel_35 = Panel(hops.Points)
panel_36 = Panel(hops.Lables)
panel_37 = Panel(hops.Cost)

# ----
# s - site
# e - site edge
# b - boundary of structure
# i - interior
# o - outside site
# x - door
panel_38 = Panel("lables")
data_8 = Data(hops.Lables)

panel_39 = Panel("cost function")
data_9 = Data(hops.Cost)

panel_40 = Panel("point grid")
pt_7 = Point(hops.Points)

# ----
# analysis and placement of package module
panel_41 = Panel("/placepackages")
data_10 = Data(split_3.ListA)
data_11 = Data(split_2.ListA)
data_12 = Data(split_4.ListA)
concat_2 = Concatenate(FragmentA="http://127.0.0.1:5000", FragmentB=panel_41)
hops_2 = Hops(
    _Path=concat_2,
    Points=pt_7,
    Cost=data_9,
    Lables=data_8,
    ModuleUse=data_11,
    ModuleGeometry=data_12,
    ModuleMask=data_10,
    Door=split.ListA,
    CacheResultsInMemory=False,
    CacheSolveResults=False,
    RemoteDefinitionLocation="http://127.0.0.1:5000/placepackages",
    RemoteSolveVersion=(0, 1, 0),
    ShowInput_Enabled=False,
    ShowInput_Path=True,
    SynchronousSolve=True)  # -> Surface, Cost, ModuleGridEdges, Lables

circle = CircleCNR(Center=pt_7, Normal=Vector(0, 0, 1), Radius=".05")
boundary_2 = BoundarySurfaces(Edges=circle)
panel_42 = Panel("grid points")
preview_2 = CustomPreview(Geometry=boundary_2, Material=ColourSwatch(SwatchColor=RGBA(0, 0, 0, 142)))

panel_43 = Panel("edge points")
pt_8 = Point(hops_2.ModuleGridEdges)

# ----
# optimally placed package module
srf_3 = Surface(hops_2.Surface)
preview_3 = CustomPreview(Geometry=srf_3, Material=ColourSwatch(SwatchColor=RGB(201, 8, 8)))

tag = TextTag3D(Location=pt_7, Text=hops_2.Cost, Size="0.1", Justification=7)

# ----
# s - site
# e - site edge
# b - boundary of structure
# i - interior
# o - outside site
# x - door
panel_44 = Panel("lables")
data_13 = Data(hops_2.Lables)

data_14 = Data(hops_2.Cost)

panel_46 = Panel(hops_2.Lables)

# ----
# analysis and placement of rest of modules
panel_47 = Panel("/placemodules")
concat_3 = Concatenate(FragmentA="http://127.0.0.1:5000", FragmentB=panel_47)
hops_3 = Hops(
    _Path=concat_3,
    Points=pt_7,
    Cost=data_9,
    Lables=data_13,
    ModuleUse=data_5,
    ModuleGeometryAsFlattenedList=data_6,
    ModuleMask=data_7,
    Doors=pshift_3,
    CacheResultsInMemory=False,
    CacheSolveResults=False,
    RemoteDefinitionLocation="http://127.0.0.1:5000/placemodules",
    RemoteSolveVersion=(0, 1, 0),
    ShowInput_Enabled=False,
    ShowInput_Path=True,
    SynchronousSolve=True)  # -> Surface, ModuleGridEdges, Lables

tag_2 = TextTag3D(Location=pt_7, Size="0.1", Justification=7)

srf_4 = Surface(hops_3.Surface)
panel_48 = Panel("optimally placed modules")
preview_4 = CustomPreview(Geometry=srf_4, Material=rgb)

pt_9 = Point(hops_3.ModuleGridEdges)

# ----
# s - site
# e - site edge
# b - boundary of structure
# i - interior
# o - outside site
# x - door
panel_50 = Panel("lables")
data_15 = Data(hops_3.Lables)

# ----
# extract points representing each type of point
# convert labels to points and output them
panel_51 = Panel("/labelstopoints1")
pt_10 = Point(pt_7)
data_16 = Data(hops_3.Lables)
concat_4 = Concatenate(FragmentA="http://127.0.0.1:5000", FragmentB=panel_51)
hops_4 = Hops(
    _Path=concat_4,
    Points=pt_10,
    Lables=data_16,
    CacheResultsInMemory=True,
    CacheSolveResults=True,
    RemoteDefinitionLocation="http://127.0.0.1:5000/labelstopoints1",
    RemoteSolveVersion=(0, 1, 0),
    ShowInput_Enabled=False,
    ShowInput_Path=True,
    SynchronousSolve=True)  # -> SitePoints, SiteEdgePoints, StructureBoundaryPoints, StructureInteriorPoints, DoorPoints, PointsOutsideOfSite

panel_52 = Panel("door")
pt_11 = Point(hops_4.DoorPoints)

panel_53 = Panel("interior")
pt_12 = Point(hops_4.StructureInteriorPoints)

panel_54 = Panel("outside site")
pt_13 = Point(hops_4.PointsOutsideOfSite)

panel_55 = Panel("boundaries")
pt_14 = Point(hops_4.StructureBoundaryPoints)

# ----
# surfaced of each module
srf_5 = Surface(hops_3.Surface)

pt_15 = Point(hops_4.SiteEdgePoints)
panel_56 = Panel("edges")

pt_16 = Point(hops_4.SitePoints)
panel_57 = Panel("site")

panel_58 = Panel("hops output")
pt_17 = Point(pt_16)
pt_18 = Point(pt_15)
pt_19 = Point(pt_12)
srf_6 = Surface(srf_5)
pt_20 = Point(pt_14)
pt_21 = Point(pt_11)
pt_22 = Point(pt_13)

edges = BrepEdges(Brep=srf_5)  # -> Naked, Interior, NonManifold

circle_2 = CircleCNR(Center=pt_14, Normal=Vector(0, 0, 1), Radius=".1")
boundary_3 = BoundarySurfaces(Edges=circle_2)
panel_59 = Panel("boundary points")
preview_5 = CustomPreview(Geometry=boundary_3, Material=ColourSwatch(SwatchColor=RGB(0, 0, 0)))

circle_3 = CircleCNR(Center=pt_11, Normal=Vector(0, 0, 1), Radius=".1")
boundary_4 = BoundarySurfaces(Edges=circle_3)
preview_6 = CustomPreview(Geometry=boundary_4, Material=ColourSwatch(SwatchColor=RGB(0, 0, 0)))
